# Grasshopper definition 003.gh (Grasshopper 1.0.9)

envelopematerialproperty = Python3Script(name="Clay Brick")  # -> out, material_prop
# ---------- envelopematerialproperty: Python ----------
#! python 3
from pod_lca.utilities import config
from pod_lca.lca_modules.building_envelope.material_property import EnvelopeMaterialPropertyMass

constructions_path = config['file_paths']['operational']['CONSTRUCTIONS']
material_prop = EnvelopeMaterialPropertyMass.from_idf(name, constructions_path)
# ---------- end envelopematerialproperty ----------
envelopematerialproperty_2 = Python3Script(name="Gypsum board")  # -> out, material_prop; same code as envelopematerialproperty
envelopematerialairgap = Python3Script(name="Generic Wall Air Gap")  # -> out, material_prop
# ---------- envelopematerialairgap: Python ----------
#! python 3
from pod_lca.utilities import config
from pod_lca.lca_modules.building_envelope.material_property import EnvelopeMaterialPropertyAirGap

constructions_path = config['file_paths']['operational']['CONSTRUCTIONS']
material_prop = EnvelopeMaterialPropertyAirGap.from_idf(name, constructions_path)
# ---------- end envelopematerialairgap ----------
envelopematerialnomass = Python3Script(name="Expanded polystyrene (EPS) Type 1")  # -> out, material_prop
# ---------- envelopematerialnomass: Python ----------
#! python 3
from pod_lca.utilities import config
from pod_lca.lca_modules.building_envelope.material_property import EnvelopeMaterialPropertyNoMass

constructions_path = config['file_paths']['operational']['CONSTRUCTIONS']
material_prop = EnvelopeMaterialPropertyNoMass.from_idf(name, constructions_path)
# ---------- end envelopematerialnomass ----------
envelopematerialnomass_2 = Python3Script(name="Mineral wool blanket baseline")  # -> out, material_prop; same code as envelopematerialnomass
panel = Panel(envelopematerialproperty.material_prop)
panel_2 = Panel(envelopematerialairgap.material_prop)
panel_3 = Panel(envelopematerialnomass_2.material_prop)
panel_4 = Panel(envelopematerialnomass.material_prop)
panel_5 = Panel(envelopematerialproperty_2.material_prop)
pt = Point([<point referenced from the Rhino model> x5])
framing = Python3Script(
    name="metal_16in",
    frame_type="Metal",
    member="400S125-18",
    spacing=Slider(16, range=0..100),
    L=Slider(1.25, range=0..10),
    ds=Slider(3.5, range=0..10),
    dII=Slider(0.043, range=0..0.1),
    unit="Inches")  # -> out, framing
# ---------- framing: Python ----------
#! python 3

from pod_lca.lca_modules.building_envelope import Framing
from pod_lca.units import INCH, METER
from pod_lca.units import Quantity as Q

if unit == "Inches":
    u = INCH
else:
    u = METER

fdata = {
    'name':    name,
    'type':    frame_type,
    'member':  member,
    'spacing': Q(float(spacing), u).convert_to(METER),
    'L':       Q(float(L), u).convert_to(METER),
    'ds':      Q(float(ds), u).convert_to(METER),
    'dII':     Q(float(dII), u).convert_to(METER),
}

framing = Framing.from_data(fdata)
print(f"Framing: {name} | {frame_type} | {member}")
# ---------- end framing ----------
pline = PolyLine(Vertices=pt, Closed=False)
layer = Python3Script(
    name="Clay Brick",
    thickness=Slider(0.75, range=0..1),
    classification="exterior_cladding",
    material=envelopematerialproperty.material_prop,
    units="Inches")  # -> out, layer
# ---------- layer: Python ----------
#! python 3

from pod_lca.lca_modules.building_envelope import Layer
from pod_lca.units import INCH, METER
from pod_lca.units import Quantity as Q

if units == "Inches":
    t = Q(float(thickness), INCH).convert_to(METER)
else:
    t = Q(float(thickness), METER)

layer = Layer.from_property_and_thickness(name, material, t, classification)
print(f"Layer: {name} | {classification}")
# ---------- end layer ----------
layer_2 = Python3Script(
    name="Generic Wall Air Gap",
    thickness=Slider(1, range=0..1),
    classification="air_gap",
    material=envelopematerialairgap.material_prop,
    units="Inches")  # -> out, layer; same code as layer
layer_3 = Python3Script(
    name="Expanded polystyrene (EPS) Type 1",
    thickness=Slider(1.5, range=-1.01..5),
    classification="exterior_insulation",
    material=envelopematerialnomass.material_prop,
    units="Inches")  # -> out, layer; same code as layer
layer_4 = Python3Script(
    name="Gypsum board",
    thickness=Slider(0.5, range=0..1),
    classification="sheathing",
    material=envelopematerialproperty_2.material_prop,
    units="Inches")  # -> out, layer; same code as layer
layer_5 = Python3Script(
    name="Mineral wool blanket baseline",
    thickness=Slider(2, range=0..2),
    classification="framing_insulation",
    material=envelopematerialnomass_2.material_prop,
    units="Inches")  # -> out, layer; same code as layer
layer_6 = Python3Script(
    name="Gypsum board",
    thickness=Slider(0.5, range=0..1),
    classification="interior_finish",
    material=envelopematerialproperty_2.material_prop,
    units="Inches")  # -> out, layer; same code as layer
number_slider = Slider(3.45, range=0..10)
polygon = Polygon(Plane=PlaneXY(0, 0, 0), Radius=Slider(26.59, range=0..100), Segments=Slider(4, range=0..10), FilletRadius=0)  # -> Polygon, Length
crv = Curve(polygon.Polygon)
panel_6 = Panel(layer.layer)
panel_7 = Panel(layer_2.layer)
panel_8 = Panel(layer_4.layer)
panel_9 = Panel(layer_5.layer)
panel_10 = Panel(layer_6.layer)
panel_11 = Panel(layer_3.layer)
panel_12 = Panel(framing.framing)
scale_nu = ScaleNU(Geometry=pline, Plane=PlaneXY(0, 0, 0), ScaleX=1, ScaleY=Slider(0.472, range=0..1), ScaleZ=1)  # -> Geometry, Transform
building_floor = Python3Script(floor_plan=scale_nu.Geometry, floor_to_floor=number_slider, building_type="Residential", unit="Meter")  # -> out, building_floor
# ---------- building_floor: Python ----------
from pod_lca.lca_modules.building import BuildingFloor
from pod_lca.units import METER
from pod_lca.units import Quantity as Q

import rhinoscriptsyntax as rs

if unit == 'Meter' or unit == 'meter':
    unit = METER
else:
    unit = None

floor_plan_ = []
for pt in rs.PolylineVertices(floor_plan):
    x, y, z = pt
    pt = [Q(x, unit), Q(y, unit), Q(z, unit)]
    floor_plan_.append(pt)  

floor_to_floor = Q(floor_to_floor, unit)


building_floor = BuildingFloor.from_floor_plan(floor_plan_, floor_to_floor, building_type)
# ---------- end building_floor ----------
number_slider_2 = Slider(8, range=0..10)
idf_path = Python3Script()  # -> out, idf_path
# ---------- idf_path: Python ----------
from pod_lca.utilities import config


idf_path = config['file_paths']['operational']['CONSTRUCTIONS']

print(idf_path)
# ---------- end idf_path ----------
framedwall = Python3Script(
    name="framed_wall_test",
    layers=[layer.layer, layer_2.layer, layer_3.layer, layer_4.layer, layer_5.layer, layer_6.layer],
    framing=framing.framing)  # -> out, framed_wall; inputs layers: list
# ---------- framedwall: Python ----------
#! python 3

from pod_lca.lca_modules.building_envelope import FramedWall

layers_dict = {}
for i, lyr in enumerate(layers):
    layers_dict[i] = lyr

framed_wall = FramedWall.from_layers_framing(name, layers_dict, framing)
framed_wall.compute_wall_r()
print(f"Framed Wall: {name} | {len(layers)} layers | R-value computed")
# ---------- end framedwall ----------
celing_from_idf = Python3Script(name="Generic Interior Ceiling", idf_path=idf_path.idf_path)  # -> out, ceiling
# ---------- celing_from_idf: Python ----------
from pod_lca.lca_modules.building_envelope import Ceiling

ceiling = Ceiling.from_idf(name, idf_path)
# ---------- end celing_from_idf ----------
strcuture_from_sample_buildings = Python3Script(
    building_type="Residential",
    structure_type="Concrete",
    mui_type="low",
    building_floor=building_floor.building_floor,
    num_stories=number_slider_2)  # -> out, structure
# ---------- strcuture_from_sample_buildings: Python ----------
from pod_lca.lca_modules.building_structure import Structure
from pod_lca.lca_modules.building_structure import StatisticalStructure

s_floor = Structure.create(structure_type, building_floor)
structure = StatisticalStructure.create(s_floor, num_stories)
structure.build(mui_type)
# ---------- end strcuture_from_sample_buildings ----------
floor_from_idf = Python3Script(name="Generic Interior Floor", idf_path=idf_path.idf_path)  # -> out, floor
# ---------- floor_from_idf: Python ----------
from pod_lca.lca_modules.building_envelope import Floor

floor = Floor.from_idf(name, idf_path)
# ---------- end floor_from_idf ----------
envelope = Python3Script(
    name="tomas_envelope",
    building_floor=building_floor.building_floor,
    floor_to_floor=number_slider,
    wall=framedwall.framed_wall,
    floor=floor_from_idf.floor,
    ceiling=celing_from_idf.ceiling,
    unit="Meter")  # -> out, envelope
# ---------- envelope: Python ----------
from pod_lca.lca_modules.building_envelope import Envelope
from pod_lca.units import METER
from pod_lca.units import Quantity as Q

print(building_floor)

# make an envelope - - - - - - - - - - - - - - - - - - - - - - - - - - - - - - - - - - - - - - -
envelope = Envelope.from_components(name,
                                    building_floor,
                                    wall=wall,
                                    floor=floor,
                                    ceiling=ceiling,
                                    windows=windows)
# ---------- end envelope ----------
building_envelope_from_envelope_stories = Python3Script(envelope=envelope.envelope, num_stories=number_slider_2)  # -> out, building_envelope; inputs num_stories: Int32
# ---------- building_envelope_from_envelope_stories: Python ----------
from pod_lca.lca_modules.building_envelope import BuildingEnvelope


building_envelope = BuildingEnvelope.from_envelope_and_stories(envelope, num_stories)
# ---------- end building_envelope_from_envelope_stories ----------
location = Python3Script(location="98126, Seattle")  # -> out, location
# ---------- location: Python ----------
from pod_lca.lca_modules.location import Location


location = Location.from_str(location)
# ---------- end location ----------
building_from_assemblies = Python3Script(
    name="tomas_building",
    building_type="Residential",
    location=location.location,
    built_year=Slider(2025, range=0..10000),
    life_span=Slider(100, range=0..100),
    structure=strcuture_from_sample_buildings.structure,
    building_envelope=building_envelope_from_envelope_stories.building_envelope,
    run=Toggle(True))  # -> out, building; inputs built_year: Int32, life_span: Int32
# ---------- building_from_assemblies: Python ----------
import sys
import importlib

def reload_library():
    # Wipe the entire library and all submodules from cache
    to_delete = [key for key in sys.modules if key == "pod_lca" or key.startswith("pod_lca.")]
    for key in to_delete:
        del sys.modules[key]

if run:

    from pod_lca.lca_modules.building import Building


    building = Building.from_assemblies(name, 
                                        location, 
                                        built_year, 
                                        life_span, 
                                        structure, 
                                        building_envelope)
# ---------- end building_from_assemblies ----------
get_impacts = Python3Script(building=building_from_assemblies.building, run=Toggle(True))  # -> out, a
# ---------- get_impacts: Python ----------
def reload_library():
    # Wipe the entire library and all submodules from cache
    to_delete = [key for key in sys.modules if key == "pod_lca" or key.startswith("pod_lca.")]
    for key in to_delete:
        del sys.modules[key]


if run:
  # get operational impacts - - - - - - - - - - - - - - - - - - - - - - - - - - - - - - - - - - - - - - -

  building.set_eplus_path("/Users/time/Documents/UW/04_code/pod_lca/pod_lca/temp/EnergyPlus-25-1-0/") # default looks standard system locations
  building.set_idf_file_path("/Users/time/Documents/UW/04_code/pod_lca/pod_lca/temp/tomas/tomas_ok.idf")
  building.set_eplus_out_folder('/Users/time/Documents/UW/04_code/pod_lca/pod_lca/temp/tomas/')
  print(building.eplus_folder_path)
  # print(building.idf_file_path)
  # print(building.eplus_out_folder)

  building.operational_energy_method = 'eplus' # {'eplus', 'EUIs'}, default is 'eplus'

  print(building.get_operational_impacts()) # default is 'total'

  # # # run embodied - - - - - - - - - - - - - - - - - - - - - - - - - - - - - - - - - - - - - - - - - - - - -

  # print(building.get_impacts(scope='product')) # {'all', 'product', 'transportation', 'construction', 'replacement', 'operational energy', 'end of life'}
  # print(building.get_emissions(scope='product'))
# ---------- end get_impacts ----------
draw_building = Python3Script(building=building_from_assemblies.building)  # -> out, envelope_surfaces
# ---------- draw_building: Python ----------
import rhinoscriptsyntax as rs


envelope_surfaces = []
for ek in building.building_envelope.envelopes:
    env = building.building_envelope.envelopes[ek]
    for sk in env.surfaces:
        print(sk)
        polygon = env.surfaces[sk].polygon
        pts = []
        for p in polygon:
            pts.append([p[0].value, p[1].value, p[2].value])
        # pts.append(pts[0])
        # print(pts)
        pl = rs.AddPolyline(pts)
        # srf = rs.AddPlanarSrf(pl)
        print(rs.IsCurveClosed(pl))
        print(pts)
        envelope_surfaces.append(pl)
        print('')
# ---------- end draw_building ----------
panel_13 = Panel(get_impacts.out)
