# Grasshopper definition Smoothie example.gh (Grasshopper 1.0.8)
# plug-ins: RhinoCodePluginGH, Bifocals

# Smoothie example
path = FilePath("C:\Users\mhtaba\Desktop\pod_lca_git\pod_lca\src\material\databaseManager\impact_data_new.csv")
pod_database = POD_database(database_path=path)  # -> out, project
# ---------- pod_database: Python ----------
# env: C:\Users\mhtaba\Desktop\pod_lca_git\pod_lca\src

import locale
locale.setlocale(locale.LC_ALL, 'en_US')
import pandas as pd

from material.projectManager.projectManager import Project

import scriptcontext as rs
 
project = Project()

rs.sticky["project"] = project

project.get_database().import_data_from_CSV(database_path)

print ("POD is running, enjoy it !!")
# ---------- end pod_database ----------
product = Product(name="Sand", qty=Slider(1, range=0..10), unit="kg", db_row="Sand")  # -> out, product; inputs qty: Double
# ---------- product: Python ----------
# env: C:\Users\mhtaba\Desktop\pod_lca_git\pod_lca\src

from material.model.product import Product
from material.model.master import Master
from material.model.product import Fuel, Emission, Waste
import scriptcontext as rs

model = rs.sticky["project"].get_model("Model_0")

if is_emission:
    emission = Emission(None, name, model, None)
    emission.set_unit(unit)
    emission.update_qty(qty)
    if db_row is not None:
        emission.set_impact_database_entry(db_row)
    process = emission

elif is_fuel:
    fuel = Fuel(None, name, model, None)
    fuel.set_unit(unit)
    fuel.update_qty(qty)
    if db_row is not None:
        fuel.set_impact_database_entry(db_row)
    process = fuel

elif is_waste:
    waste = Waste(None, name, model, None)
    waste.set_unit(unit)
    waste.update_qty(qty)
    if db_row is not None:
        waste.set_impact_database_entry(db_row)
    process = waste




product = Product(None, name, model, None)
product.set_unit(unit)
product.update_qty(qty)
if db_row is not None:
    product.set_impact_database_entry(db_row)
# ---------- end product ----------
product_2 = Product(name="Pickles", qty=Slider(0.516, range=0..1), unit="kg", db_row="Pickles")  # -> out, product; inputs qty: Double; same code as product
product_3 = Product(name="Sprinkles", qty=Slider(2, range=0..10), unit="kg", db_row="Sprinkles")  # -> out, product; inputs qty: Double; same code as product
product_4 = Product(name="Propane", qty=Slider(0.516, range=0..1), unit="MJ", db_row="Propane")  # -> out, product; inputs qty: Double; same code as product
number_slider = Slider(0.516, range=0..1)
panel = Panel(pod_database.out)
product_5 = Product(
    name="Impacts from Process 3 CO2 (carbon dioxide)",
    qty=Slider(0.516, range=0..1),
    unit="kg",
    db_row="CO2",
    is_fuel=Toggle(True))  # -> out, product; inputs qty: Double; same code as product
product_6 = Product(
    name="Impacts from Process 3 CH4 (methane)",
    qty=Slider(0.295, range=0..1),
    unit="kg",
    db_row="CH4",
    is_fuel=Toggle(True))  # -> out, product; inputs qty: Double; same code as product
product_7 = Product(
    name="Energy for Process 3 (Chemical Reaction)",
    qty=Slider(0.295, range=0..1),
    unit="kWh",
    db_row="Propane",
    is_emission="Electricity",
    is_fuel=Toggle(True))  # -> out, product; inputs qty: Double; same code as product
product_8 = Product(name="Energy for Process 1 (Mixing)", unit="kWh", db_row="Electricity", is_fuel=Toggle(True))  # -> out, product; inputs qty: Double; same code as product
product_9 = Product(
    name="Energy for Process 2 (Heating)",
    qty=Slider(0.295, range=0..1),
    unit="MJ",
    db_row="Propane",
    is_emission="Propane",
    is_fuel=Toggle(True))  # -> out, product; inputs qty: Double; same code as product
transportation = Transportation(
    name="Sprinkels transportation",
    qty=Slider(32, range=0..100),
    unit="km",
    products=product_3.product,
    db_row="Transportation by truck")  # -> out, transportation; inputs products: list
# ---------- transportation: Python ----------
# env: C:\Users\mhtaba\Desktop\pod_lca_git\pod_lca\src

from material.model.process import transportationProcess
import scriptcontext as rs

model = rs.sticky["project"].get_model("Model_0")

transportation = transportationProcess(None, name, model, None)
transportation.set_transported_distance_unit(unit)
transportation.set_transported_products(products)
transportation.set_transported_distance(qty)
if db_row is not None:
    transportation.set_impact_database_entry(db_row)
# ---------- end transportation ----------
transportation_2 = Transportation(
    name="Sand transportation",
    qty=Slider(30, range=0..100),
    unit="km",
    products=product.product,
    db_row="Transportation by truck")  # -> out, transportation; inputs products: list; same code as transportation
transportation_3 = Transportation(
    name="Propane transportation",
    qty=Slider(30, range=0..100),
    unit="km",
    products=product_4.product,
    db_row="Transportation by truck")  # -> out, transportation; inputs products: list; same code as transportation
transportation_4 = Transportation(
    name="product1 transportation",
    qty=Slider(3, range=0..100),
    unit="km",
    products=product_8.product,
    db_row="Transportation by truck")  # -> out, transportation; inputs products: list; same code as transportation
transportation_5 = Transportation(
    name="Sprinkels transportation",
    qty=Slider(30, range=0..100),
    unit="km",
    products=product_2.product,
    db_row="Transportation by barge")  # -> out, transportation; inputs products: list; same code as transportation
transportation_6 = Transportation(
    name="product2 transportation",
    qty=Slider(14, range=0..100),
    unit="km",
    products=product_9.product,
    db_row="Transportation by truck")  # -> out, transportation; inputs products: list; same code as transportation
a2_list = A2List(transportation=[transportation.transportation, transportation_5.transportation, transportation_3.transportation, transportation_6.transportation, transportation_4.transportation, transportation_2.transportation])  # -> out, A2; inputs transportation: list
# ---------- a2_list: Python ----------
# env: C:\Users\mhtaba\Desktop\pod_lca_git\pod_lca\src

for process in transportation:
    process.set_life_cycle_stage('A2')

A2 = transportation
# ---------- end a2_list ----------
a3_list = A3List(processes=[product_5.product, product_6.product, product_8.product, product_9.product, product_7.product])  # -> out, A3; inputs processes: list
# ---------- a3_list: Python ----------
# env: C:\Users\mhtaba\Desktop\pod_lca_git\pod_lca\src

for process in processes:
    process.set_life_cycle_stage('A3')

A3 = processes
# ---------- end a3_list ----------
a1_list = A1List(products=[product_3.product, product.product, product_4.product, product_2.product])  # -> out, A1; inputs products: list
# ---------- a1_list: Python ----------
# env: C:\Users\mhtaba\Desktop\pod_lca_git\pod_lca\src

for product in products:
    product.set_life_cycle_stage('A1')

A1 = products
# ---------- end a1_list ----------
model = Model(A1=a1_list.A1, A2=a2_list.A2, A3=a3_list.A3)  # -> out, model; inputs A1: list, A2: list, A3: list
# ---------- model: Python ----------
# env: C:\Users\mhtaba\Desktop\pod_lca_git\pod_lca\src

import scriptcontext as rs

project = rs.sticky["project"]

model = project.get_model("Model_0")
impacts = model.get_impacts()

lst_A1 = []
for item in A1:
    lst_A1.append(item.get_impacts())

lst_A2 = []
for item in A2:
    lst_A2.append(item.get_impacts())

lst_A3 = []
for item in A3:
    lst_A3.append(item.get_impacts())

impacts["A1"] = lst_A1
impacts["A2"] = lst_A2
impacts["A3"] = lst_A3
# ---------- end model ----------
panel_2 = Panel("""GWP
acid_pot""")

# ----
# Under develop
python_3_script = Python3Script(
    process_name="Mixing",
    product_transport=[product_3.product, transportation_2.transportation, product.product, product_8.product])  # -> out, a; unedited script template
python_3_script_2 = Python3Script(process_name="Heating", product_transport=python_3_script.a)  # -> out, a; unedited script template
python_3_script_3 = Python3Script()  # -> out, a
# ---------- python_3_script_3: Python ----------
# env: C:\Users\mhtaba\Desktop\pod_lca_git\pod_lca\src

from material.model.process import Process
import scriptcontext as rs

model = rs.sticky["project"].get_model("Model_0")


Process
# ---------- end python_3_script_3 ----------

calculator = Python3Script(model=model.model, impact_cat=panel_2)  # -> out, plt_data
# ---------- calculator: Python ----------
# env: C:\Users\mhtaba\Desktop\pod_lca_git\pod_lca\src
import numpy as np
import scriptcontext as rs

project = model.get_project()

calcualtor = project.get_calculator()
data_dict = calcualtor.get_data_by_LCstage(impact_cat)[0]

plt_data = [data_dict["A1"], data_dict["A2"], data_dict["A3"]]

print (plt_data)

species = ('GWP', 'acid_pot', 'eutro_pot', 'ozone_dep','smog')
sex_counts = {
    'A1': np.array([73, 34, 61, 34, 12]),
    'A2': np.array([73, 34, 58, 13, 10]),
    'A3': np.array([73, 34, 58, 34, 23]),
}
width = 0.6  # the width of the bars: can also be len(x) sequence
# ---------- end calculator ----------
barchart_stages_multiy = Barchart_Stages_multiy(model=model.model, impact_cat=panel_2, run=Toggle(False))  # -> out, plt_data, impact_list; inputs impact_cat: list
# ---------- barchart_stages_multiy: Python ----------
# env: C:\Users\mhtaba\Desktop\pod_lca_git\pod_lca\src
import scriptcontext as rs
from material.calculator.calculator import Calculator


project = model.get_project()

calcualtor = project.get_calculator()

data_dict = calcualtor.get_data_by_LCstage(impact_cat[0])[0]

plt_data = [data_dict["A1"], data_dict["A2"], data_dict["A3"]]


impact_list = []
for i in range (len(impact_cat)):
    data_dict = calcualtor.get_data_by_LCstage(impact_cat[i])[0]
    plt_data = [data_dict["A1"], data_dict["A2"], data_dict["A3"]]
    impact_list.append (plt_data)


if run:
    calcualtor.Multi_bar_chart(impact_cat)
# ---------- end barchart_stages_multiy ----------
barchart_stages_single = Barchart_Stages_single(model=model.model, impact_cat="GWP", run=Toggle(False))  # -> out, plt_data
# ---------- barchart_stages_single: Python ----------
# env: C:\Users\mhtaba\Desktop\pod_lca_git\pod_lca\src

import scriptcontext as rs
from material.calculator.calculator import Calculator


project = model.get_project()

calcualtor = project.get_calculator()
data_dict = calcualtor.get_data_by_LCstage(impact_cat)[0]

plt_data = [data_dict["A1"], data_dict["A2"], data_dict["A3"]]

if run:
    calcualtor.Barchart(impact_cat)
# ---------- end barchart_stages_single ----------
barchart_stage_by_parts = Barchart_Stage_by_parts(model=model.model, impact_cat="acid_pot")  # -> out, plt_data
# ---------- barchart_stage_by_parts: Python ----------
# env: C:\Users\mhtaba\Desktop\pod_lca_git\pod_lca\src

import scriptcontext as rs
from material.calculator.calculator import Calculator


project = model.get_project()

calcualtor = project.get_calculator()

if run:
    calcualtor.barchart_by_parts(impact_cat)
# ---------- end barchart_stage_by_parts ----------
barchart_stage_by_parts_2 = Barchart_Stage_by_parts(model=model.model, impact_cat="acid_pot", run=Toggle(False))  # -> out, plt_data; same code as barchart_stage_by_parts
python_3_script_4 = Python3Script(run=Toggle(False))  # -> out, a
# ---------- python_3_script_4: Python ----------
import plotly.graph_objects as go

if run:
    
    fig = go.Figure(data=[go.Sankey(
        node = dict(
        pad = 15,
        thickness = 20,
        line = dict(color = "black", width = 0.8),
        label = ["Tomas concrete", "Cement production",  "Clinker production", "Calcareous marl",
            "market for clay",  "market for lime",  "market for trasport"],
        color = "blue"
        ),
        link = dict(
        source = [0, 0, 2, 2, 3, 3,3,4], # indices correspond to labels, eg A1, A2, A1, B1, ...
        target = [1, 2, 6, 3, 1, 4,6,5],
        value = [8, 4, 2, 8, 4, 2,3,5]
    ))])

    fig.update_layout(title_text="Basic Sankey Diagram", font_size=10)
    fig.show()
# ---------- end python_3_script_4 ----------
panel_3 = Panel(barchart_stages_single.plt_data)
panel_4 = Panel(calculator.plt_data)
