# Grasshopper definition ghModel_Mo 01.gh (Grasshopper 1.0.8)
# plug-ins: RhinoCodePluginGH

path = FilePath("C:\Users\mhtaba\Desktop\pod_lca_git\pod_lca\src\material\databaseManager\impact_data.csv")
project = Python3Script(database_path=path)  # -> out, project
# ---------- project: Python ----------
# env: C:\Users\mhtaba\Desktop\pod_lca_git\pod_lca\src

import locale
locale.setlocale(locale.LC_ALL, 'en_US')
import pandas as pd

from material.projectManager.projectManager import Project

import scriptcontext as rs
 
project = Project()

rs.sticky["project"] = project

project.get_database().import_data_from_CSV(database_path)
# ---------- end project ----------
product = Python3Script(name="Pickles", qty=Slider(0.516, range=0..1), unit="kg", db_row="Pickles")  # -> out, product
# ---------- product: Python ----------
# env: C:\Users\mhtaba\Desktop\pod_lca_git\pod_lca\src

from material.model.product import Product
import scriptcontext as rs

model = rs.sticky["project"].get_model()

product = Product(None, name, model, None)
product.set_unit(unit)
product.update_qty(qty)
if db_row is not None:
    product.set_database_row(db_row)
# ---------- end product ----------
product_2 = Python3Script(name="Sprinkles", qty=Slider(2, range=0..10), unit="kg", db_row="Sprinkles")  # -> out, product
# ---------- product_2: Python ----------
# env: C:\Users\mhtaba\Desktop\pod_lca_git\pod_lca\src

from material.model.product import Product
import scriptcontext as rs

model = rs.sticky["project"].get_model()

product = Product(None, name, model, None)
product.set_unit(unit)
product.update_qty(qty)
if db_row is not None:  
    product.set_database_row(db_row)
# ---------- end product_2 ----------
product_3 = Python3Script(name="Sand", qty=Slider(1, range=0..10), unit="kg", db_row="Sand")  # -> out, product; inputs qty: Double; same code as product
product_4 = Python3Script(name="Propane", qty=Slider(0.516, range=0..1), unit="MJ", db_row="Propane")  # -> out, product; same code as product
process = Python3Script(name="Impacts from Process 3 CO2 (carbon dioxide)", qty=Slider(0.516, range=0..1), unit="kg", db_row="CO2")  # -> out, process
# ---------- process: Python ----------
# env: C:\Users\mhtaba\Desktop\pod_lca_git\pod_lca\src

from material.model.process import Process
import scriptcontext as rs

model = rs.sticky["project"].get_model()

process = Process(None, name, model, None)
process.set_unit(unit)
process.update_qty(qty)
if db_row is not None:
    process.set_database_row(db_row)
# ---------- end process ----------
process_2 = Python3Script(name="Impacts from Process 3 CH4 (methane)", qty=Slider(0.295, range=0..1), unit="kg", db_row="CH4")  # -> out, process; same code as process
process_3 = Python3Script(name="Energy for Process 3 NH3 (ammonia)", qty=Slider(0.295, range=0..1), unit="kg", db_row="NH3")  # -> out, process; same code as process
process_4 = Python3Script(name="Energy for Process 2 (Heating)", qty=Slider(0.295, range=0..1), unit="MJ", db_row="Propane")  # -> out, process; same code as process
process_5 = Python3Script(name="Waste from Process 3 (Chemical Reaction)", qty=Slider(1, range=0..1), unit="kg", db_row="Waste to landfill")  # -> out, process; same code as process
process_6 = Python3Script(name="Energy for Process 1 (Mixing)", qty=Slider(0.516, range=0..1), unit="kWh", db_row="Electricity")  # -> out, process; same code as process
process_7 = Python3Script(name="Energy for Process 3 (Chemical Reaction)", qty=Slider(0.295, range=0..1), unit="kWh", db_row="Electricity")  # -> out, process; same code as process
process_8 = Python3Script(
    name="Sand transportation",
    qty=Slider(30, range=0..100),
    unit="km",
    products=product_3.product,
    db_row="Transportation by truck")  # -> out, transportation
# ---------- process_8: Python ----------
# env: C:\Users\mhtaba\Desktop\pod_lca_git\pod_lca\src

from material.model.process import transportationProcess
import scriptcontext as rs

model = rs.sticky["project"].get_model()

transportation = transportationProcess(None, name, model, None)
transportation.set_transported_distance_unit(unit)
transportation.set_transported_products(products)
transportation.set_transported_distance(qty)
if db_row is not None:
    transportation.set_database_row(db_row)
# ---------- end process_8 ----------
process_9 = Python3Script(
    name="Sprinkels transportation",
    qty=Slider(32, range=0..100),
    unit="km",
    products=product_2.product,
    db_row="Transportation by truck")  # -> out, transportation; same code as process_8
process_10 = Python3Script(
    name="Propane transportation",
    qty=Slider(30, range=0..100),
    unit="km",
    products=product_4.product,
    db_row="Transportation by truck")  # -> out, transportation; same code as process_8
process_11 = Python3Script(
    name="Sprinkels transportation",
    qty=Slider(30, range=0..100),
    unit="km",
    products=product.product,
    db_row="Transportation by barge")  # -> out, transportation; same code as process_8
a2 = Python3Script(transportation=[process_8.transportation, process_9.transportation, process_11.transportation, process_10.transportation])  # -> out, A2; inputs transportation: list
# ---------- a2: Python ----------
# env: C:\Users\mhtaba\Desktop\pod_lca_git\pod_lca\src

for process in transportation:
    process.set_life_cycle_stage('A2')

A2 = transportation
# ---------- end a2 ----------
a1 = Python3Script(products=[product_2.product, product_3.product, product_4.product, product.product])  # -> out, A1; inputs products: list
# ---------- a1: Python ----------
# env: C:\Users\mhtaba\Desktop\pod_lca_git\pod_lca\src

for product in products:
    product.set_life_cycle_stage('A1')

A1 = products
# ---------- end a1 ----------
a3 = Python3Script(processes=[process_6.process, process_4.process, process_7.process, process.process, process_2.process, process_3.process, process_5.process])  # -> out, A3; inputs processes: list
# ---------- a3: Python ----------
# env: C:\Users\mhtaba\Desktop\pod_lca_git\pod_lca\src

for process in processes:
    process.set_life_cycle_stage('A3')

A3 = processes
# ---------- end a3 ----------
model = Python3Script(A1=a1.A1, A2=a2.A2, A3=a3.A3)  # -> out, model; inputs A1: list, A2: list, A3: list
# ---------- model: Python ----------
# env: C:\Users\mhtaba\Desktop\pod_lca_git\pod_lca\src

import scriptcontext as rs

project = rs.sticky["project"]

model = project.get_model()
impacts = model.get_impacts()

lst_A1 = []
for item in A1:
    lst_A1.append(item.get_impacts())

lst_A2 = []
for item in A2:
    lst_A2.append(item.get_impacts())

lst_A3 = []
for item in A3:
    lst_A3.append(item.get_impacts())

impacts["A1"] = lst_A1
impacts["A2"] = lst_A2
impacts["A3"] = lst_A3
# ---------- end model ----------

panel = Panel("""GWP
acid_pot""")
# Plot functions
calculator = Python3Script(model=model.model, impact_cat="GWP")  # -> out, plt_data
# ---------- calculator: Python ----------
# env: C:\Users\mhtaba\Desktop\pod_lca_git\pod_lca\src

import scriptcontext as rs

project = model.get_project()

calcualtor = project.get_calculator()
data_dict = calcualtor.get_data_by_LCstage(impact_cat)

plt_data = [data_dict["A1"], data_dict["A2"], data_dict["A3"]]
# ---------- end calculator ----------
calculator_2 = Python3Script(model=model.model, impact_cat="GWP", run=Toggle(False))  # -> out, plt_data
# ---------- calculator_2: Python ----------
# env: C:\Users\mhtaba\Desktop\pod_lca_git\pod_lca\src

import scriptcontext as rs
from material.calculator.calcualtor import Calculator


project = model.get_project()

calcualtor = project.get_calculator()
data_dict = calcualtor.get_data_by_LCstage(impact_cat)

plt_data = [data_dict["A1"], data_dict["A2"], data_dict["A3"]]

if run:
    calcualtor.Barchart(impact_cat)
# ---------- end calculator_2 ----------
calculator_3 = Python3Script(model=model.model, impact_cat=panel, run=Toggle(False))  # -> out, plt_data; inputs impact_cat: list
# ---------- calculator_3: Python ----------
# env: C:\Users\mhtaba\Desktop\pod_lca_git\pod_lca\src
import scriptcontext as rs
from material.calculator.calcualtor import Calculator


project = model.get_project()

calcualtor = project.get_calculator()

if run:
    calcualtor.Multi_bar_chart(impact_cat)
# ---------- end calculator_3 ----------
calculator_4 = Python3Script(model=model.model, impact_cat=panel)  # -> out, plt_data
# ---------- calculator_4: Python ----------
# env: C:\Users\mhtaba\Desktop\pod_lca_git\pod_lca\src
import numpy as np
import scriptcontext as rs

project = model.get_project()

calcualtor = project.get_calculator()
data_dict = calcualtor.get_data_by_LCstage(impact_cat)

plt_data = [data_dict["A1"], data_dict["A2"], data_dict["A3"]]

print (plt_data)

species = ('GWP', 'acid_pot', 'eutro_pot', 'ozone_dep','smog')
sex_counts = {
    'A1': np.array([73, 34, 61, 34, 12]),
    'A2': np.array([73, 34, 58, 13, 10]),
    'A3': np.array([73, 34, 58, 34, 23]),
}
width = 0.6  # the width of the bars: can also be len(x) sequence
# ---------- end calculator_4 ----------
panel_2 = Panel(calculator_4.plt_data)
panel_3 = Panel(calculator.plt_data)

calculator_5 = Python3Script(model=model.model, impact_cat="acid_pot", run=Toggle(False))  # -> out, plt_data
# ---------- calculator_5: Python ----------
# env: C:\Users\mhtaba\Desktop\pod_lca_git\pod_lca\src

import scriptcontext as rs
from material.calculator.calcualtor import Calculator


project = model.get_project()

calcualtor = project.get_calculator()

if run:
    calcualtor.barchart_by_parts(impact_cat)
# ---------- end calculator_5 ----------
