# Grasshopper definition ghModel_KIUN.gh (Grasshopper 1.0.8)
# plug-ins: RhinoCodePluginGH

panel = Panel("C:\Users\kiun\pod_lca\src\material\databaseManager\impact_data.csv")
# Global variable.
# [https://developer.rhino3d.com/guides/rhinopython/ghpython-global-sticky/]
project = Python3Script(database_path=panel)  # -> out, project
# ---------- project: Python ----------
# env: C:\Users\kiun\pod_lca\src

import locale
locale.setlocale(locale.LC_ALL, 'en_US')
import pandas as pd

from material.projectManager.projectManager import Project

import scriptcontext as rs
 
project = Project()

rs.sticky["project"] = project

project.get_database().import_data_from_CSV(database_path)
# ---------- end project ----------
# Notes:
# --------
# 1. Importing packages
# [https://developer.rhino3d.com/guides/rhinopython/python-packages/]
# 2. However, there is an known issue with importing pandas
# [https://discourse.mcneel.com/t/issues-installing-pandas-on-script-editor/166071]
panel_2 = Panel("Sand")
product = Python3Script(name="Sand", qty=Slider(0.516, range=0..1), unit="lb", db_row=panel_2)  # -> out, product
# ---------- product: Python ----------
# env: C:\Users\kiun\pod_lca\src

from material.model.product import Product
import scriptcontext as rs

model = rs.sticky["project"].get_model()

product = Product(None, name, model, None)
product.set_unit(unit)
product.update_qty(qty)
if db_row is not None:
    product.set_database_row(db_row)
# ---------- end product ----------
product_2 = Python3Script(name="Sprinkles", qty=Slider(0.422, range=0..1), unit="kg", db_row="Sprinkles")  # -> out, product
# ---------- product_2: Python ----------
# env: C:\Users\kiun\pod_lca\src

from material.model.product import Product
import scriptcontext as rs

model = rs.sticky["project"].get_model()

product = Product(None, name, model, None)
product.set_unit(unit)
product.update_qty(qty)
if db_row is not None:  
    product.set_database_row(db_row)
# ---------- end product_2 ----------
process = Python3Script(
    name="Sand transportation",
    qty=Slider(0.596, range=0..1),
    unit="mi",
    products=product.product,
    db_row="Transportation by truck")  # -> out, transportation
# ---------- process: Python ----------
# env: C:\Users\kiun\pod_lca\src\

from material.model.process import transportationProcess
import scriptcontext as rs

model = rs.sticky["project"].get_model()

transportation = transportationProcess(None, name, model, None)
transportation.set_transported_distance_unit(unit)
transportation.set_transported_products(products)
transportation.set_transported_distance(qty)
if db_row is not None:
    transportation.set_database_row(db_row)
# ---------- end process ----------
process_2 = Python3Script(name="Process 2: Mixing", qty=Slider(0.25, range=0..1), unit="kg")  # -> out, process
# ---------- process_2: Python ----------
# env: C:\Users\kiun\pod_lca\src

from material.model.process import Process
import scriptcontext as rs

model = rs.sticky["project"].get_model()

process = Process(None, name, None, None)
process.set_unit(unit)
process.update_qty(qty)
if db_row is not None:
    process.set_database_row(db_row)
# ---------- end process_2 ----------
process_3 = Python3Script(name="Process 1: Mixing", qty=Slider(0.25, range=0..1), unit="kg")  # -> out, process; same code as process_2
a2 = Python3Script(transportation=process.transportation)  # -> out, A2; inputs transportation: list
# ---------- a2: Python ----------
# env: C:\Users\kiun\pod_lca\src

for process in transportation:
    process.set_life_cycle_stage('A2')

A2 = transportation
# ---------- end a2 ----------
a1 = Python3Script(products=[product_2.product, product.product])  # -> out, A1; inputs products: list
# ---------- a1: Python ----------
# env: C:\Users\kiun\pod_lca\src\

for product in products:
    product.set_life_cycle_stage('A1')

A1 = products
# ---------- end a1 ----------
a3 = Python3Script(processes=[process_3.process, process_2.process])  # -> out, A3; inputs processes: list
# ---------- a3: Python ----------
# env: C:\Users\kiun\pod_lca\src

for process in processes:
    process.set_life_cycle_stage('A3')

A3 = processes
# ---------- end a3 ----------
model = Python3Script(A1=a1.A1, A2=a2.A2, A3=a3.A3)  # -> out, model; inputs A1: list, A2: list, A3: list
# ---------- model: Python ----------
# env: C:\Users\kiun\pod_lca\src

import scriptcontext as rs

project = rs.sticky["project"]

model = project.get_model()
impacts = model.get_impacts()

lst_A1 = []
for item in A1:
    lst_A1.append(item.get_impacts())

lst_A2 = []
for item in A2:
    lst_A2.append(item.get_impacts())

lst_A3 = []
for item in A3:
    lst_A3.append(item.get_impacts())

impacts["A1"] = lst_A1
impacts["A2"] = lst_A2
impacts["A3"] = lst_A3
# ---------- end model ----------
# Only one manipulation implemented here.
# Can add various manipulation of the data to Calculaotr method and call them here.
# The output data can be fed into a plotter.
panel_3 = Panel("GWP")
calculator = Python3Script(model=model.model, impact_cat=panel_3)  # -> out, plt_data
# ---------- calculator: Python ----------
# env: C:\Users\kiun\pod_lca\src

import scriptcontext as rs

project = model.get_project()

calcualtor = project.get_calculator()
data_dict = calcualtor.get_data_by_LCstage(impact_cat)

plt_data = [data_dict["A1"], data_dict["A2"], data_dict["A3"]]
# ---------- end calculator ----------
panel_4 = Panel(calculator.plt_data)
