# Grasshopper definition Smoothie example.gh (Grasshopper 1.0.8)
# plug-ins: RhinoCodePluginGH, Bifocals

# Smoothie example
path = FilePath("C:\Users\mhtaba\Desktop\pod_lca_git\pod_lca\src\material\databaseManager\impact_data_new.csv")
pod_database = POD_database(database_path=path)  # -> out, project
# ---------- pod_database: Python ----------
import locale
locale.setlocale(locale.LC_ALL, 'en_US')
import pandas as pd

from material.projectManager.projectManager import Project

import scriptcontext as rs
 
project = Project()

rs.sticky["project"] = project

project.get_database().import_data_from_CSV(database_path)

print ("POD is running, enjoy it !!")
# ---------- end pod_database ----------
product = Product(name="Sand", qty=Slider(1, range=0..10), unit="kg", db_row="Sand")  # -> out, product; inputs qty: Double
# ---------- product: Python ----------
# env: C:\Users\mhtaba\Desktop\pod_lca_git\pod_lca\src

from material.model.product import Product
from material.model.master import Master
from material.model.product import Fuel, Emission, Waste
import scriptcontext as rs

model = rs.sticky["project"].get_model("Model_0")

if is_emission:
    emission = Emission(None, name, model, None)
    emission.set_unit(unit)
    emission.update_qty(qty)
    if db_row is not None:
        emission.set_impact_database_entry(db_row)
    process = emission

elif is_fuel:
    fuel = Fuel(None, name, model, None)
    fuel.set_unit(unit)
    fuel.update_qty(qty)
    if db_row is not None:
        fuel.set_impact_database_entry(db_row)
    process = fuel

elif is_waste:
    waste = Waste(None, name, model, None)
    waste.set_unit(unit)
    waste.update_qty(qty)
    if db_row is not None:
        waste.set_impact_database_entry(db_row)
    process = waste




product = Product(None, name, model, None)
product.set_unit(unit)
product.update_qty(qty)
if db_row is not None:
    product.set_impact_database_entry(db_row)
# ---------- end product ----------
product_2 = Product(name="Pickles", qty=Slider(0.491, range=0..1), unit="kg", db_row="Pickles")  # -> out, product; inputs qty: Double; same code as product
product_3 = Product(name="Sprinkles", qty=Slider(2, range=0..10), unit="kg", db_row="Sprinkles")  # -> out, product; inputs qty: Double; same code as product
product_4 = Product(name="Propane", qty=Slider(0.516, range=0..1), unit="MJ", db_row="Propane")  # -> out, product; inputs qty: Double; same code as product
boolean_toggle = BooleanToggle(True)
number_slider = Slider(0.516, range=0..1)
panel = Panel(pod_database.out)
product_5 = Product(
    name="Impacts from Process 3 CO2 (carbon dioxide)",
    qty=Slider(0.516, range=0..1),
    unit="kg",
    db_row="CO2",
    is_emission=boolean_toggle,
    is_fuel=boolean_toggle)  # -> out, product; inputs qty: Double; same code as product
product_6 = Product(name="Waste to landfill", qty=Slider(0.295, range=0..1), unit="kg", db_row="Waste to landfill", is_waste=Toggle(True))  # -> out, product; inputs qty: Double; same code as product
product_7 = Product(
    name="Impacts from Process 3 CH4 (methane)",
    qty=Slider(0.295, range=0..1),
    unit="kg",
    db_row="CH4",
    is_emission=Toggle(True))  # -> out, product; inputs qty: Double; same code as product
product_8 = Product(
    name="Energy for Process 3 (Chemical Reaction)",
    qty=Slider(0.295, range=0..1),
    unit="kWh",
    db_row="Electricity",
    is_fuel=Toggle(True))  # -> out, product; inputs qty: Double; same code as product
product_9 = Product(name="Energy for Process 1 (Mixing)", unit="kWh", db_row="Electricity", is_fuel=Toggle(True))  # -> out, product; inputs qty: Double; same code as product
product_10 = Product(name="Energy for Process 2 (Heating)", qty=Slider(0.278, range=0..1), unit="MJ", db_row="Propane", is_fuel=Toggle(True))  # -> out, product; inputs qty: Double; same code as product
transportation = Transportation(
    name="Sand transportation",
    qty=Slider(30, range=0..100),
    unit="km",
    products=product.product,
    db_row="Transportation by truck")  # -> out, transportation; inputs products: list
# ---------- transportation: Python ----------
# env: C:\Users\mhtaba\Desktop\pod_lca_git\pod_lca\src

from material.model.process import transportationProcess
import scriptcontext as rs

model = rs.sticky["project"].get_model("Model_0")

transportation = transportationProcess(None, name, model, None)
transportation.set_transported_distance_unit(unit)
transportation.set_transported_products(products)
transportation.set_transported_distance(qty)
if db_row is not None:
    transportation.set_impact_database_entry(db_row)
# ---------- end transportation ----------
transportation_2 = Transportation(
    name="Sprinkels transportation",
    qty=Slider(32, range=0..100),
    unit="km",
    products=product_3.product,
    db_row="Transportation by truck")  # -> out, transportation; inputs products: list; same code as transportation
transportation_3 = Transportation(
    name="product1 transportation",
    qty=Slider(3, range=0..100),
    unit="km",
    products=product_9.product,
    db_row="Transportation by truck")  # -> out, transportation; inputs products: list; same code as transportation
transportation_4 = Transportation(
    name="Sprinkels transportation",
    qty=Slider(30, range=0..100),
    unit="km",
    products=product_2.product,
    db_row="Transportation by barge")  # -> out, transportation; inputs products: list; same code as transportation
transportation_5 = Transportation(
    name="product2 transportation",
    qty=Slider(14, range=0..100),
    unit="km",
    products=product_10.product,
    db_row="Transportation by truck")  # -> out, transportation; inputs products: list; same code as transportation
transportation_6 = Transportation(
    name="Propane transportation",
    qty=Slider(18, range=0..100),
    unit="km",
    products=product_4.product,
    db_row="Transportation by truck")  # -> out, transportation; inputs products: list; same code as transportation
a2_list = A2List(transportation=[transportation_2.transportation, transportation_4.transportation, transportation_6.transportation, transportation_5.transportation, transportation_3.transportation, transportation.transportation])  # -> out, A2; inputs transportation: list
# ---------- a2_list: Python ----------
# env: C:\Users\mhtaba\Desktop\pod_lca_git\pod_lca\src

for process in transportation:
    process.set_life_cycle_stage('A2')

A2 = transportation
# ---------- end a2_list ----------
a3_list = A3List(processes=[product_5.product, product_7.product, product_9.product, product_10.product, product_8.product, product_6.product])  # -> out, A3; inputs processes: list
# ---------- a3_list: Python ----------
# env: C:\Users\mhtaba\Desktop\pod_lca_git\pod_lca\src

for process in processes:
    process.set_life_cycle_stage('A3')

A3 = processes
# ---------- end a3_list ----------
a1_list = A1List(products=[product_3.product, product.product, product_4.product, product_2.product])  # -> out, A1; inputs products: list
# ---------- a1_list: Python ----------
# env: C:\Users\mhtaba\Desktop\pod_lca_git\pod_lca\src

for product in products:
    product.set_life_cycle_stage('A1')

A1 = products
# ---------- end a1_list ----------
model = Model(A1=a1_list.A1, A2=a2_list.A2, A3=a3_list.A3)  # -> out, model; inputs A1: list, A2: list, A3: list
# ---------- model: Python ----------
# env: C:\Users\mhtaba\Desktop\pod_lca_git\pod_lca\src

import scriptcontext as rs

project = rs.sticky["project"]

model = project.get_model("Model_0")
impacts = model.get_impacts()

lst_A1 = []
for item in A1:
    lst_A1.append(item.get_impacts())

lst_A2 = []
for item in A2:
    lst_A2.append(item.get_impacts())

lst_A3 = []
for item in A3:
    lst_A3.append(item.get_impacts())

impacts["A1"] = lst_A1
impacts["A2"] = lst_A2
impacts["A3"] = lst_A3
# ---------- end model ----------
panel_2 = Panel("""GWP
AP
EP
ODP
SFP""")
calculator = Python3Script(model=model.model, impact_cat=panel_2)  # -> out, plt_data; inputs impact_cat: list
# ---------- calculator: Python ----------
# env: C:\Users\mhtaba\Desktop\pod_lca_git\pod_lca\src
import numpy as np
import scriptcontext as rs

project = model.get_project()

calcualtor = project.get_calculator()


final_list = []
for i in impact_cat:

    data_dict = calcualtor.get_data_by_LCstage(i)[0]
    plt_data = [data_dict["A1"], data_dict["A2"], data_dict["A3"]]

    final_list.append(plt_data)


print (final_list)
# ---------- end calculator ----------
barchart_stages_multiy = Barchart_Stages_multiy(model=model.model, impact_cat=panel_2, run=Toggle(False))  # -> out, plt_data, impact_list; inputs impact_cat: list
# ---------- barchart_stages_multiy: Python ----------
# env: C:\Users\mhtaba\Desktop\pod_lca_git\pod_lca\src
import scriptcontext as rs
from material.calculator.calculator import Calculator


project = model.get_project()

calcualtor = project.get_calculator()

data_dict = calcualtor.get_data_by_LCstage(impact_cat[0])[0]

plt_data = [data_dict["A1"], data_dict["A2"], data_dict["A3"]]


impact_list = []
for i in range (len(impact_cat)):
    data_dict = calcualtor.get_data_by_LCstage(impact_cat[i])[0]
    plt_data = [data_dict["A1"], data_dict["A2"], data_dict["A3"]]
    impact_list.append (plt_data)


if run:
    calcualtor.Multi_bar_chart(impact_cat)
# ---------- end barchart_stages_multiy ----------
barchart_stages_single = Barchart_Stages_single(model=model.model, impact_cat="SFP", run=Toggle(False))  # -> out, plt_data
# ---------- barchart_stages_single: Python ----------
project = model.get_project()

calcualtor = project.get_calculator()
data_dict = calcualtor.get_data_by_LCstage(impact_cat)[0]

plt_data = [data_dict["A1"], data_dict["A2"], data_dict["A3"]]

if run:
    calcualtor.Barchart(impact_cat)
# ---------- end barchart_stages_single ----------
barchart_stage_by_parts = Barchart_Stage_by_parts(model=model.model, impact_cat="GWP", run=Toggle(False))  # -> out, plt_data
# ---------- barchart_stage_by_parts: Python ----------
project = model.get_project()

calcualtor = project.get_calculator()

if run:
    calcualtor.barchart_by_parts(impact_cat)
# ---------- end barchart_stage_by_parts ----------
barchart_stage_by_parts_2 = Barchart_Stage_by_parts(model=model.model, impact_cat="ODP", Models="Model_0", run=Toggle(False))  # -> out, plt_data; inputs Models: list
# ---------- barchart_stage_by_parts_2: Python ----------
from material.visualizer.bar_chart import BarChart
from material.visualizer.plotter import Plotter

project = model.get_project()

barchart = BarChart(project)



barchart.set_impact_category(impact_cat)
barchart.set_active_models(Models)
if run:
    barchart.show()
# ---------- end barchart_stage_by_parts_2 ----------
barchart_stage_by_parts_3 = Barchart_Stage_by_parts(model=model.model, impact_cat="ODP", Models="Model_0", run=Toggle(False))  # -> out, plt_data; inputs Models: list
# ---------- barchart_stage_by_parts_3: Python ----------
from material.visualizer.bar_chart2 import BarChart2
from material.visualizer.plotter import Plotter

project = model.get_project()

barchart = BarChart2(project)



barchart.set_impact_category(impact_cat)
barchart.set_active_models(Models)
if run:
    barchart.show()
# ---------- end barchart_stage_by_parts_3 ----------
panel_3 = Panel(barchart_stages_single.plt_data)
panel_4 = Panel(calculator.out)
# Under develop
toggle = BooleanToggle(False)
python_3_script = Python3Script(process_name="Product 1")  # -> out, a; inputs inputs: list; unedited script template
python_3_script_2 = Python3Script(
    name="Product1",
    inputs=[product.product, product_3.product, transportation.transportation, transportation_2.transportation, product_9.product],
    run=toggle)  # -> out, G; inputs inputs: list
# ---------- python_3_script_2: Python ----------
import networkx as nx
import matplotlib.pyplot as plt



# Create a simple graph
G = nx.Graph()

G.add_node(name)
for i in inputs:
    G.add_edge(i, name)


# Draw the graph
nx.draw(G, with_labels=True)

if run:
    # Show the graph
    plt.show()
# ---------- end python_3_script_2 ----------
python_3_script_3 = Python3Script(run=Toggle(False))  # -> out, a; inputs label: list
# ---------- python_3_script_3: Python ----------
import plotly.graph_objects as go






if run:
    
    fig = go.Figure(data=[go.Sankey(
        node = dict(
        pad = 15,
        thickness = 20,
        line = dict(color = "black", width = 0.8),
        label = ["Tomas concrete", "Cement production",  "Clinker production", "Calcareous marl",
            "market for clay",  "market for lime",  "market for trasport"],
        color = "blue"
        ),
        link = dict(
        source = [0, 0, 2, 2, 3, 3,3,4], # indices correspond to labels, eg A1, A2, A1, B1, ...
        target = [1, 2, 6, 3, 1, 4,6,5],
        value = [8, 4, 2, 8, 4, 2,3,5]
    ))])

    fig.update_layout(title_text="Basic Sankey Diagram", font_size=10)
    fig.show()
# ---------- end python_3_script_3 ----------
python_3_script_4 = Python3Script(
    process_name="Product 2",
    product_transport=[product_4.product, product_2.product, product_10.product, transportation_6.transportation, python_3_script.a])  # -> out, a; unedited script template
python_3_script_5 = Python3Script(
    name="Product2",
    inputs=[product_4.product, product_2.product, transportation_6.transportation, transportation_4.transportation],
    run=Toggle(True),
    G=python_3_script_2.G)  # -> out, G; inputs inputs: list
# ---------- python_3_script_5: Python ----------
import networkx as nx
import matplotlib.pyplot as plt


G.add_node(name)
for i in inputs:
    G.add_edge(i, name)

# Draw the graph
nx.draw(G, with_labels=True)

if run:
    # Show the graph
    plt.show()


print(G.nodes())
# ---------- end python_3_script_5 ----------
python_3_script_6 = Python3Script(process_name="Final_product", product_transport=[transportation_3.transportation, transportation_5.transportation])  # -> out, a; unedited script template
