# Grasshopper definition Transportation example.gh (Grasshopper 1.0.8)
# plug-ins: RhinoCodePluginGH

transportation = Product(
    name="Project_1",
    location="Seattle",
    material="Carpet",
    qty=Slider(200, range=0..1000),
    travel_dist="Local",
    return_trip_factor=Slider(1.5, range=0..10),
    dist_unit="km",
    mode="None",
    eff=Slider(0.9, range=0..1))  # -> out; inputs location: String, data_folder: String, qty: Double
# ---------- transportation: Python ----------
# env: C:\Users\mhtaba\Desktop\pod_lca_git\pod_lca\src

from lca_modules.transportation.project_logistic_manager import ProjectLogisticManager
import scriptcontext as rs

#model = rs.sticky["project"].get_model("Model_0")

data_folder = r"C:\Users\mhtaba\Desktop\pod_lca_git\pod_lca\data\transportation_dataset"
project = ProjectLogisticManager(name, location , data_folder)


project.create_link ( material, qty, travel_dist, return_trip_factor, dist_unit, mode, eff)

print (project.get_imapct())
# ---------- end transportation ----------
panel = Panel(transportation)
