# Grasshopper definition ghmodel.gh (Grasshopper 1.0.8)
# plug-ins: RhinoCodePluginGH

# ----
# Installing pandas
py3 = Python3Script()  # -> out, a
# ---------- py3: Python ----------
# r: psycopg2, pandas, openpyxl

import locale
locale.setlocale(locale.LC_ALL, 'en_US')

import pandas
# ---------- end py3 ----------

py3_2 = Python3Script(keyword="Pickles", Category="Flow", Quantity=Slider(4, range=0..10))  # -> out, Material; inputs keyword: String, Category: String, Quantity: Double
# ---------- py3_2: Python ----------
import pandas as pd

df = pd.read_csv ('C://Users/mhtaba/Desktop/pod_lca_git/pod_lca/src/material/databaseManager/impact_data.csv')

# print(df.head())
# a = list (df.columns)

def data (a):
    Material = df[df[a] == keyword]
    Material = Material.iloc[:,2:7]
    return Material * Quantity

Material = data(Category)
# ---------- end py3_2 ----------
py3_3 = Python3Script(keyword="Sprinkles", Category="Flow", Quantity=Slider(2, range=0..10))  # -> out, Material; inputs keyword: String, Category: String, Quantity: Double; same code as py3_2
py3_4 = Python3Script(keyword="Propane", Category="Flow", Quantity=Slider(1, range=0..10))  # -> out, Material; inputs keyword: String, Category: String, Quantity: Double; same code as py3_2
# Materials
py3_5 = Python3Script(keyword="Sand", Category="Flow", Quantity=Slider(1, range=0..10))  # -> out, Material; inputs keyword: String, Category: String, Quantity: Double; same code as py3_2

# ----
# plt test
py3_6 = Python3Script()  # -> out, a
# ---------- py3_6: Python ----------
import matplotlib.pyplot as plt
import numpy as np

# Generate random data using numpy
np.random.seed(42)
sepal_width = np.random.rand(150) * 4 + 2  # Random values between 2 and 6
sepal_length = np.random.rand(150) * 3 + 4  # Random values between 4 and 7
species = np.random.choice([0, 1, 2], size=150)  # Random species (0, 1, or 2)

# Define color mapping for species
colors = np.array(['red', 'green', 'blue'])

# Create the scatter plot
plt.figure(figsize=(10, 6))
plt.scatter(sepal_width, sepal_length, c=colors[species], alpha=0.7, edgecolor='k')

# Add title and labels
plt.title("Random Flower Sepal Dimensions")
plt.xlabel("Sepal Width (cm)")
plt.ylabel("Sepal Length (cm)")
plt.grid(True)

# Show the plot
plt.show()
# ---------- end py3_6 ----------

# ----
# LCA import
py3_7 = Python3Script()  # -> out, a
# ---------- py3_7: Python ----------
import sys
import os

# # Replace this with the path to your Python files
module_path = r'C://Users/mhtaba/Desktop/pod_lca_git/pod_lca/src'

if module_path not in sys.path:
    sys.path.append(module_path)


import material.model.impacts as lca

# Use functions from your module
a = lca.Impacts.updateImpactQty
# ---------- end py3_7 ----------

py3_8 = Python3Script(x=Slider(0, range=0..100))  # -> out, a; inputs x: Int32
# ---------- py3_8: Python ----------
b = ["asli", 'mo', 'sarv']


a= b [x]
# ---------- end py3_8 ----------
py3_9 = Python3Script(x=[py3_5.Material, py3_3.Material, py3_4.Material, py3_2.Material])  # -> out, a; inputs x: list
# ---------- py3_9: Python ----------
a = sum(x)
# ---------- end py3_9 ----------
panel = Panel(py3_8.a)
panel_2 = Panel(py3_9.a)

# ----
# Transports
material = GhPythonScript(Keyword="Pickles", Distance=Slider(20, range=0..100))  # -> out, Transport; unedited script template
material_2 = GhPythonScript(Keyword="Pickles", Distance=Slider(17, range=0..100))  # -> out, Transport; unedited script template
material_3 = GhPythonScript(Keyword="Pickles", Distance=Slider(40, range=0..100))  # -> out, Transport; unedited script template
material_4 = GhPythonScript(Keyword="Pickles", Distance=Slider(30, range=0..100))  # -> out, Transport; unedited script template

# ----
# A1
material_5 = GhPythonScript()  # -> out, Impacts, A2; unedited script template

merge = Merge(Data1=material_3.Transport, Data2=material_4.Transport, Data3=material.Transport, Data4=material_2.Transport)

# ----
# A2
material_6 = GhPythonScript(A1=material_5.A2, Transportation=merge)  # -> out, Impacts, A2; unedited script template

bang = ExplodeTree(Data=material_6.A2)  # -> Branch0, Branch1, Branch2, Branch3
material_7 = GhPythonScript(Keyword="Pickles", Distance=Slider(40, range=0..100))  # -> out, Transport; unedited script template
material_8 = GhPythonScript(Keyword="Electricity", Quantity=Slider(40, range=0..100))  # -> out, Energy; unedited script template
material_9 = GhPythonScript(Keyword="Pickles", Distance=Slider(40, range=0..100))  # -> out, Transport; unedited script template

# ----
# Energy
material_10 = GhPythonScript(Keyword="Electricity", Quantity=Slider(40, range=0..100))  # -> out, Energy; unedited script template

material_11 = GhPythonScript(Name="Mixing", Energy=material_10.Energy, Transport=material_9.Transport, Materials=[bang.Branch0, bang.Branch1])  # -> out, Process; unedited script template
material_12 = GhPythonScript(Name="Heating", Energy=material_8.Energy, Transport=material_7.Transport, Materials=[bang.Branch2, bang.Branch3])  # -> out, Process; unedited script template
merge_2 = Merge(Data1=material_11.Process, Data2=material_12.Process)
material_13 = GhPythonScript(Keyword="Pickles", Distance=Slider(40, range=0..100))  # -> out, Transport; unedited script template
material_14 = GhPythonScript(Keyword="Electricity", Quantity=Slider(40, range=0..100))  # -> out, Energy; unedited script template
material_15 = GhPythonScript(Name="Heating", Energy=material_14.Energy, Transport=material_13.Transport, Materials=merge_2)  # -> out, Process; unedited script template

# ----
# A3
material_16 = GhPythonScript(Processers=material_15.Process)  # -> out, Impacts, A3; unedited script template
